# Grasshopper definition twisted_tower.gh (Grasshopper 1.0.7)

cluster = Cluster()
lenght = Slider(60, range=10..100)
width = Slider(48, range=10..100)
f2f = Slider(3, range=3..7)
floors = Slider(30, range=1..30)
rotation = Slider(-37, range=-90..90)
floor_thck = Slider(0.3, range=0.1..1.1)
length = GetNumber(lenght, AtLeast=1, AtMost=2147483647, Maximum=1.797693135e+308, Minimum=-1.797693135e+308)
floor_heigth = GetNumber(f2f, AtLeast=1, AtMost=2147483647, Maximum=1.797693135e+308, Minimum=-1.797693135e+308)
floors_2 = GetNumber(floors, AtLeast=1, AtMost=2147483647, Maximum=1.797693135e+308, Minimum=-1.797693135e+308)
rotation_2 = GetNumber(rotation, AtLeast=1, AtMost=2147483647, Maximum=1.797693135e+308, Minimum=-1.797693135e+308)
width_2 = GetNumber(width, AtLeast=1, AtMost=2147483647, Maximum=1.797693135e+308, Minimum=-1.797693135e+308)
pt = ConstructPoint(XCoordinate=0, YCoordinate=0, ZCoordinate=0)
rectangle = Rectangle(Plane=pt, XSize=length, YSize=width_2, Radius=0)  # -> Rectangle, Length
series = Series(Start=0, Step=floor_heigth, Count=floors_2)
Z = UnitZ(Factor=series)
move = Move(Geometry=rectangle.Rectangle, Motion=Z)  # -> Geometry, Transform
area = Area(Geometry=move.Geometry)  # -> Area, Centroid
lng = ListLength(List=move.Geometry)  # -> expr("X-1", Length)
dom = ConstructDomain(DomainStart=0, DomainEnd=rotation_2)
range = Range(Domain=dom, Steps=lng)
rotate = Rotate(Geometry=move.Geometry, Angle=degrees(range), Plane=area.Centroid)  # -> Geometry, Transform
crv = Curve(rotate.Geometry)

Z_2 = UnitZ(Factor=floor_thck)
neg = Negative(Value=Z_2)
extr = Extrude(Base=crv, Direction=neg)
cap = CapHoles(Brep=extr)

mesh = MeshBrep(
    Brep=cap,
    Settings={GridMaxCount=0, GridMinCount=16, JaggedSeams=False, MaxEdgeLength=0, MinEdgeLength=0.0001, MinTolerance=0, Refine=True, RefineAngle=0, RelativeTolerance=0.65, SimplePlanes=True, Tolerance=0})

# ---- group: RH_OUT:Mesh
mesh_2 = Mesh(mesh)

# ==== cluster Cluster
